# Dynamo graph Footprint.dyn (Dynamo 2.18.1.5096)
# packages: DynamoForma 1.0.0

footprints = FormaSelectFootprints("")  # graph input
footprint = DynamoForma.FormaElement.Footprint(formaElement=footprints)
byPatch = Surface.ByPatch(closedCurve=footprint)
area = Surface.Area(surface=byPatch)
area_2 = Watch(area)
