# Dynamo graph Geometry.dyn (Dynamo 2.18.1.5096)
# packages: DynamoForma 1.0.0

geometry = FormaSelectGeometry("")  # graph input
meshToSolid = DynamoForma.FormaElement.MeshToSolid(formaElement=geometry)
color_palette = ColorPalette({R: 0, G: 78, B: 153, A: 255})  # graph input
byGeometryColor = Modifiers.GeometryColor.ByGeometryColor(geometry=meshToSolid, color=color_palette)
watch_3d = Watch3D(byGeometryColor)  # graph output
