# Dynamo graph Metrics.dyn (Dynamo 2.18.1.5096)
# packages: DynamoForma 1.0.0

custom_selection = CustomSelection("Residential", items={Residential: "residential", Commercial: "commercial", Unspecified: "unspecified"})
metrics = FormaSelectMetrics("")  # graph input
watch = Watch(metrics)
custom_selection_2 = CustomSelection("Gfa", items={Gfa: "grossFloorArea", Two: "2", Three: "3"})
code_block = CodeBlock(x=watch, metricKey=custom_selection_2) { x["builtInMetrics"][metricKey]["functionBreakdown"]; }
code_block_2 = CodeBlock(x=code_block) { x[0]; x[1]; x[2]; }
code_block_3 = CodeBlock(x=code_block_2.out0) { x["functionName"] + ": " + x["value"]; }
metric_1 = Watch(code_block_3)  # graph output
code_block_4 = CodeBlock(x=code_block_2.out1) { x["functionName"] + ": " + x["value"]; }
metric_2 = Watch(code_block_4)  # graph output
code_block_5 = CodeBlock(x=code_block_2.out2) { x["functionName"] + ": " + x["value"]; }
metric_3 = Watch(code_block_5)  # graph output
code_block_6 = CodeBlock {  }
