# Dynamo graph Triangles.dyn (Dynamo 3.0.0.6366)

# group: Triangles
triangles = StringInput("")  # graph input
parseJSON = Data.ParseJSON(json=triangles)
code_block = CodeBlock { 3; -2; }
takeEveryNthItem = List.TakeEveryNthItem(list=parseJSON@L2, n=code_block.out0, offset=code_block.out1)
code_block_2 = CodeBlock { -1; }
takeEveryNthItem_2 = List.TakeEveryNthItem(list=parseJSON@L2, n=code_block.out0, offset=code_block_2)
takeEveryNthItem_3 = List.TakeEveryNthItem(list=parseJSON@L2, n=code_block.out0)
byCoordinates = Point.ByCoordinates(x=takeEveryNthItem, y=takeEveryNthItem_2, z=takeEveryNthItem_3)
chop = List.Chop(list=byCoordinates@L2, lengths=code_block.out0)
code_block_3 = CodeBlock { true; }
byPoints = PolyCurve.ByPoints(points=chop@@L2, connectLastToFirst=code_block_3)
boolean = BoolSelector(false)
clean = List.Clean(list=byPoints@L2, preserveIndices=boolean)
byPatch = Surface.ByPatch(closedCurve=clean)
byJoinedSurfaces = Solid.ByJoinedSurfaces(facesOfSolid=byPatch)

unscaled = Watch3D(byJoinedSurfaces)  # graph output
