# Dynamo graph Geometry-CreatePixelTower.dyn "PixelTower_NativeFormaElements" (Dynamo 3.3.0.6316)
# author: Autodesk
# Generate a Pixelated Tower inspired by the MahanNakhon tower by Buro Ole Scheeren Architects, a mixed-use high-rise in Bangkok Thailand. Leverages the connected client nodes to create native Forma Buildings.
# packages: DynamoFormaBeta 4.0.0.0

# group: Inputs
# How we control our overall Tower dimensions. These have all been set as "isInput" on the nodal right-click context menu to ensure they show up in the Dynamo Player in Forma.
# note: Set overall dimensions of Cube modules
cube_module_dimensions = IntegerSlider(3, range=3..20 step 1)  # graph input
# note: Set overall spread of our Cube modules
cube_module_spread = IntegerSlider(7, range=5..20 step 1)  # graph input
# note: Set overall Tower Height
overall_tower_height = IntegerSlider(130, range=100..1000 step 10)  # graph input
# note: Choose distance factor to remove Cubes
cubes_removal_factor = IntegerSlider(3, range=0..4 step 0)  # graph input
commercial_levels_count = IntegerSlider(5, range=0..100 step 1)  # graph input

# group: Define overall Tower Dimensions
setting_tower_dimensions = CodeBlock(cubeDimensions=cube_module_dimensions, cubeSpread=cube_module_spread, towerHeight=overall_tower_height)
# ---------- setting_tower_dimensions.designscript (11 lines) ----------
//Setting overall dimensions of our pixelated Cuboid
cubeDimensions;

//Setting overall XY plane size of pixelated Tower
towerSize = cubeDimensions * cubeSpread;

//Create XY range around 0,0,0 point
horizRange = -(towerSize/2)..(towerSize/2)..cubeDimensions;

//Create height range of pixelated Tower
heightRange = 0..towerHeight..cubeDimensions;
# ----------------------------------------

# group: Create Cuboid Tower (Solid)
# note: Create a single cuboid, then translate it around (More performant than genreating new ones)
byLengths = Cuboid.ByLengths(width=setting_tower_dimensions.cubeDimensions, length=setting_tower_dimensions.cubeDimensions, height=setting_tower_dimensions.cubeDimensions)
identity = CoordinateSystem.Identity()
# note: Generating a three-dimensional CoordinateSystem grid
byOrigin = CoordinateSystem.ByOrigin(x=setting_tower_dimensions.horizRange, y=setting_tower_dimensions.horizRange, z=setting_tower_dimensions.heightRange, lacing=CrossProduct)
# note: Transforming Cubes generates an overall pixelated tower
transform = Geometry.Transform(geometry=byLengths, fromCoordinateSystem=identity, contextCoordinateSystem=byOrigin)

# group: Define NurbsCurve point locations
setting_curve_dimensions = CodeBlock(towerSize=setting_tower_dimensions.towerSize, cubeDimensions=setting_tower_dimensions.cubeDimensions, towerHeight=overall_tower_height)
# ---------- setting_curve_dimensions.designscript (14 lines) ----------
//Setting an overall starting value
pointDistance = (towerSize / 2) + (cubeDimensions * 2);

//Setting X value locations for our Points to wrap around tower
x = [-pointDistance, pointDistance, pointDistance,
	-pointDistance, -pointDistance, pointDistance];

//Setting Y value locations for our Points to wrap around tower
y = [-pointDistance, -pointDistance, pointDistance,
	pointDistance, -pointDistance, -pointDistance];

//Setting Z value locations for our Points to wrap around tower
z = [0, towerHeight * 0.25, towerHeight * 0.5,
	towerHeight * 0.75, towerHeight, towerHeight * 1.25];
# ----------------------------------------

# group: Create NurbsCurve for distance checking
# note: Create points from location data
byCoordinates = Point.ByCoordinates(x=setting_curve_dimensions.x, y=setting_curve_dimensions.y, z=setting_curve_dimensions.z)
# note: Generate NurbsCurve from our control points that wraps around the building as a spiral
byControlPoints = NurbsCurve.ByControlPoints(points=byCoordinates)

# group: Removing Cuboids based on proxmity to NurbsCurve
# note: Query the distance of each Cube to our NurbsCurve in order to remove Cubes within a set distance
distanceTo = Geometry.DistanceTo(geometry=transform, other=byControlPoints)
code_block = CodeBlock(cubeDimensions=setting_tower_dimensions.cubeDimensions, cubeRemovalFactor=cubes_removal_factor)
# ---------- code_block.designscript (2 lines) ----------
//Calculating distance for cube removal
cubeDimensions * cubeRemovalFactor;
# ----------------------------------------
# note: Creatte Boolean Mask based on our Cube removal factor
le = distanceTo <= code_block
# note: Split Cubes into Remain and Remove
filterByBoolMask = List.FilterByBoolMask(list=transform, mask=le)

# group: Create a single Solid
flatten = List.Flatten(list=filterByBoolMask.out)
byGeometry = BoundingBox.ByGeometry(geom=flatten@L1)
minPoint = BoundingBox.MinPoint(boundingBox=byGeometry)
# note: Collecting a single point per Cube, located at the lowest point and pulling it's vertical Z-value.
Z = Point.Z(point=minPoint)
# note: Group all Cubes vertically by their Bounding Box minimum Z point.
groupByKey = List.GroupByKey(list=flatten, keys=Z)
# note: Union together all Cubes by level
byUnion = Solid.ByUnion(solids=groupByKey.groups)

# group: Create Perimeter Curves
# note: Explode unioned Cubes to expose floor plate Surface
explode = Geometry.Explode(geometry=byUnion)
code_block_2 = CodeBlock { 0.5; }
pointAtParameter = Surface.PointAtParameter(surface=explode, u=code_block_2, v=code_block_2)
Z_2 = Point.Z(point=pointAtParameter)
minimumItem = List.MinimumItem(list=Z_2@L2)
eq = Z_2 == minimumItem
# note: Collect only the bottom surface (Floor plate) by the Z-value of a point at the middle of each surface
filterByBoolMask_2 = List.FilterByBoolMask(list=explode, mask=eq)
# note: Get the Floor plate at each level
perimeterCurves = Surface.PerimeterCurves(surface=filterByBoolMask_2.in)
# note: Generate a singular PolyCurve from the Floor Plate boundary
byGroupedCurves = PolyCurve.ByGroupedCurves(curves=perimeterCurves)
count = List.Count(list=perimeterCurves)
sub = count - commercial_levels_count

# group: Create GFA Units and Representation
getProject = GetProjectHttp("{\"projectId\":\"pro_0xt8n1odg1\",\"region\":\"US\"}")  # graph input
code_block_3 = CodeBlock { "residential"; "commercial"; }
ofRepeatedItem = List.OfRepeatedItem(item=code_block_3.out1, amount=commercial_levels_count)
ofRepeatedItem_2 = List.OfRepeatedItem(item=code_block_3.out0, amount=sub)
join = List.Join(list0=ofRepeatedItem, list1=ofRepeatedItem_2)
code_block_4 = CodeBlock { null; }
# note: Generate GFA Units from the floor plates
byCurveAndElevation = Forma.Representations.GFAUnits.ByCurveAndElevation(closedCurve=byGroupedCurves, functionId=join, areaType=code_block_4)
flatten_2 = List.Flatten(list=byCurveAndElevation)
# note: Create GFAUnits, needed for the Representation to be created correctly
byUnits = Forma.Representations.GFAUnits.ByUnits(gfaUnits=flatten_2)
byUnion_2 = Solid.ByUnion(solids=byUnion)
# note: Create a Volume Mesh of the overall Tower solid to add into our Representation to send to Forma
byMeshOrSolid = Forma.Representations.VolumeMesh.ByMeshOrSolid(project=getProject, meshOrSolid=byUnion_2)
list_create = List.Create(item0=byUnits, item1=byMeshOrSolid)
# note: Choose color based on function ID and defining the Category in our Properties
code_block_5 = CodeBlock(functionId=join)
# ---------- code_block_5.designscript (8 lines) ----------
buildingFunction = functionId == "residential" ? "#FFEAA5" :
		functionId == "commercial" ? "#D8DCFF" :
			"#999999";
properties =
{
	"color": buildingFunction,
	"category": "building"
};
# ----------------------------------------
# note: Creating a Representation in Forma of the Building by setting Volume Mesh, GFA Units and Properties
byRepresentations = Forma.Elements.System.Integrate.ByRepresentations(project=getProject, reperesentations=list_create, properties=code_block_5.properties)

# group: Send to Forma
sendElementsToForma = SendElementsToForma(elements=byRepresentations)  # graph output
