# Dynamo graph Metrics-BuildingCostCalculator.dyn "BuildingCostCalculator_FormaAPI" (Dynamo 3.3.0.6316)
# author: Autodesk
# Calculate the cost of Residential, Commercial and Unspecified space and a consultants percentage based on local rates.
# packages: DynamoFormaBeta 4.0.0.0

# group: Inputs
select_buildings = SelectElementsHttp("{\"elements\":[{\"urn\":\"urn:adsk-forma-elements:basicbuilding:pro_0xt8n1odg1:28dw4m3ex9:1728666856878\",\"path\":\"root/76fd4eb\",\"worldTransform\":[1,0,0,0,0,1,0,0,0,0,1,0,85.23384854895994,-32.88916952442378,0,1]},{\"urn\":\"urn:adsk-forma-elements:parametric:pro_0xt8n1odg1:4535cd5bda8de:1728666627177\",\"path\":\"root/f862597\",\"worldTransform\":[1,0,0,0,0,1,0,0,0,0,1,0,0,0,0,1]}],\"region\":\"US\"}")  # graph input
area_calculation_values = CustomSelection("Gross Floor Area (GFA)", items={Gross Floor Area (GFA): "0", Gross Internal Area (GIA): "1", Net Internal Area (NIA): "2"}, IsVisibleDropDownTextBlock=true)  # graph input
commercial_rate = DoubleInput(200)  # graph input
currency_symbol = StringInput("$")  # graph input
unspecified_rate = DoubleInput(75)  # graph input
residential_rate = DoubleInput(100)  # graph input
consultants_rate = DoubleInput(5)  # graph input

# group: Confirm Selection has Representations
getAllChildren = Forma.Elements.Element.GetAllChildren(element=select_buildings)
code_block = CodeBlock { "gfaUnits"; }
hasRepresentation = Forma.Elements.Element.HasRepresentation(element=getAllChildren, key=code_block)
filterByBoolMask = List.FilterByBoolMask(list=getAllChildren, mask=hasRepresentation)

# group: Collect GFA Units and pull Surface Area
GFAUnits = Forma.Elements.Element.GFAUnits(elements=filterByBoolMask.in@L1)
byPatch = Surface.ByPatch(closedCurve=GFAUnits.curve)
safeguard_nulls = CodeBlock(inp=GFAUnits.functionId) { inp == null ? "none" : inp; }
groupByKey = List.GroupByKey(list=byPatch@L2, keys=safeguard_nulls@L2)
area = Surface.Area(surface=groupByKey.groups)
sum = Math.Sum(values=area)

# group: Calculation and pair together GFA, GIA, and NIA
path = Forma.Elements.Element.Path(element=filterByBoolMask.in)
code_block_2 = CodeBlock { 0; }
round = Math.Round(number=sum, digits=code_block_2)
byKeysValues = DesignScript.Builtin.Dictionary.ByKeysValues(keys=groupByKey.uniqueKeys@L2, values=round@L2)
# note: Gross Internal Area (GIA) calculation per building and paired with floor Functions
byKeysValues_2 = DesignScript.Builtin.Dictionary.ByKeysValues(keys=path, values=byKeysValues)
# note: GIA Calculation factor set at 90% of the GFA value
gia_at_90_of_gfa = CodeBlock(GFA=sum) { GFA * 0.9; }
round_2 = Math.Round(number=gia_at_90_of_gfa, digits=code_block_2)
byKeysValues_3 = DesignScript.Builtin.Dictionary.ByKeysValues(keys=groupByKey.uniqueKeys@L2, values=round_2@L2)
byKeysValues_4 = DesignScript.Builtin.Dictionary.ByKeysValues(keys=path, values=byKeysValues_3)
# note: NIA Calculation factor set at 81% of the GFA value
nia_at_81_of_gfa = CodeBlock(GFA=sum) { GFA * 0.81; }
round_3 = Math.Round(number=nia_at_81_of_gfa, digits=code_block_2)
byKeysValues_5 = DesignScript.Builtin.Dictionary.ByKeysValues(keys=groupByKey.uniqueKeys@L2, values=round_3@L2)
# note: Net internal Area (NIA) calculation per building and paired with floor Functions
byKeysValues_6 = DesignScript.Builtin.Dictionary.ByKeysValues(keys=path, values=byKeysValues_5)

# group: Format summated areas into legible string with currency symbol
valueAtKey = DesignScript.Builtin.Dictionary.ValueAtKey()  # unwired: dictionary, key
list_create = List.Create(item0=byKeysValues_2, item1=byKeysValues_4, item2=byKeysValues_6)
getItemAtIndex = List.GetItemAtIndex(list=list_create, index=area_calculation_values)
components = DesignScript.Builtin.Dictionary.Components(dictionary=getItemAtIndex)
code_block_3 = CodeBlock { "residential"; "commercial"; "unspecified"; "none"; }
# note: Intentionally suppressing the Null warning here as we know it will occur and are handling it downstream using Function Passing
function_apply = ApplyFunction(function=valueAtKey, argument0=components.values, argument1=code_block_3.out1)
mul = function_apply * commercial_rate
null_check = CodeBlock(inp=mul) { inp == null ? 0 : inp; }
sum_2 = Math.Sum(values=null_check)
# note: Double Sum to remove nested behavior
sum_3 = Math.Sum(values=sum_2)
code_block_4 = CodeBlock(value=sum_3, currencySymbol=currency_symbol) { formatToCurrency(value, currencySymbol); }
function_apply_2 = ApplyFunction(function=valueAtKey, argument0=components.values, argument1=code_block_3.out2)
mul_2 = function_apply_2 * unspecified_rate
null_check_2 = CodeBlock(inp=mul_2) { inp == null ? 0 : inp; }
sum_4 = Math.Sum(values=null_check_2)
sum_5 = Math.Sum(values=sum_4)
code_block_5 = CodeBlock(value=sum_5, currencySymbol=currency_symbol) { formatToCurrency(value, currencySymbol); }
function_apply_3 = ApplyFunction(function=valueAtKey, argument0=components.values, argument1=code_block_3.out0)
mul_3 = function_apply_3 * residential_rate
null_check_3 = CodeBlock(inp=mul_3) { inp == null ? 0 : inp; }
sum_6 = Math.Sum(values=null_check_3)
sum_7 = Math.Sum(values=sum_6)
code_block_6 = CodeBlock(value=sum_7, currencySymbol=currency_symbol) { formatToCurrency(value, currencySymbol); }
format_currency_defintion = CodeBlock()
# ---------- format_currency_defintion.designscript (29 lines) ----------
def formatToCurrency(value : var[]..[], currencySymbol : string)
{
	//Convert cost numbers into a String
	stringifyValue = value + "";

	//Remove all decimal places to represent whole numbers
	splitString = String.Split(stringifyValue, ["."]);
	getWholeNumber = List.FirstItem(splitString@L2<1>);

	//Split string into single characters to easily manipulate
	singleChars = String.Split(getWholeNumber, [""]);

	//Adding in comma separators into chopped character list
	reverseChars = List.Reverse(singleChars@L2<1>);
	chopIntoThrees = List.Chop(reverseChars@L2<1>, 3);
	addCommas = List.AddItemToEnd(",", chopIntoThrees@@L2<1>);

	//Adding in Currency Symbol to end of list
	addSymbol = List.AddItemToEnd(currencySymbol, addCommas@@L3<1>);
	flattenSymbolList = List.Flatten(addSymbol@L3<1>, 1);
	reverseSymbolList = List.Reverse(flattenSymbolList@@L2<1>);

	//Remove erroneous comma and rehydrate into single strings
	removeComma = List.RemoveItemAtIndex(reverseSymbolList@@L2<1>, 1);
	concatenatedString = String.Concat([removeComma]);
	flattenList = List.Flatten(concatenatedString, -1);

	return flattenList;
};
# ----------------------------------------
function_apply_4 = ApplyFunction(function=valueAtKey, argument0=components.values, argument1=code_block_3.out3)
mul_4 = function_apply_4 * unspecified_rate
null_check_4 = CodeBlock(inp=mul_4) { inp == null ? 0 : inp; }
sum_8 = Math.Sum(values=null_check_4)
sum_9 = Math.Sum(values=sum_8)
code_block_7 = CodeBlock(value=sum_9, currencySymbol=currency_symbol) { formatToCurrency(value, currencySymbol); }
join = List.Join(list0=sum_7, list1=sum_3, list2=sum_5, list3=sum_9)
boolean = BoolSelector(false)
clean = List.Clean(list=join, preserveIndices=boolean)
sum_10 = Math.Sum(values=clean)
sum_11 = Math.Sum(values=sum_10)
code_block_8 = CodeBlock(consultantRate=consultants_rate, overallCost=sum_11, currencySymbol=currency_symbol) { consultantCost = (consultantRate/100)*overallCost; formatted = formatToCurrency(consultantCost, currencySymbol); }
code_block_9 = CodeBlock { "-"; }
code_block_10 = CodeBlock(value=sum_11, currencySymbol=currency_symbol) { formatToCurrency(value, currencySymbol); }

# group: Missing Data Check
code_block_11 = CodeBlock(flatList=code_block_4) { symbolCheck = flatList == "$" ? "N/A" : flatList; nullCheck = symbolCheck == null ? "N/A" :symbolCheck; }
code_block_12 = CodeBlock(flatList=code_block_5) { symbolCheck = flatList < 0 ? flatList : "N/A"; nullCheck = symbolCheck == null ? "N/A" :symbolCheck; }
code_block_13 = CodeBlock(flatList=code_block_6) { symbolCheck = flatList == "$" ? "N/A" : flatList; nullCheck = symbolCheck == null ? "N/A" :symbolCheck; }

# group: Outputs into Dynamo Player in Forma
commercial_cost = Watch(code_block_11.nullCheck)  # graph output
unspecified_cost = Watch(code_block_12.nullCheck)  # graph output
residential_cost = Watch(code_block_13.nullCheck)  # graph output
no_function_applied = Watch(code_block_7)  # graph output
consulant_fee = Watch(code_block_8.formatted)  # graph output
watch = Watch(code_block_9)  # graph output
overall_cost = Watch(code_block_10)  # graph output
