# Dynamo graph Area Calculation.dyn (Dynamo 3.4.0.6892)
# author: The Dynamo Team
# Calculate area of Buildings based on FunctionID and Unit Type. Requires the GFAUnit representation. The graph will visualize what is included and excluded. NOTE: results can only be seen if you turn off the visibility of Buildings.
# packages: DynamoFormaBeta 1.0.0.0, MeshToolkit 5.1.0, DynamoFormaBeta 4.2.2.0

# group: Get all the elements from the Site
get_all_elements_from_site = GetAllElementsHttp("{\"elements\":[{\"urn\":\"urn:adsk-forma-elements:proposal:pro_mnpo1vppxk:a95de7fb-8aff-4fb7-8488-db57574f3d39:1743445002091\",\"path\":\"root\",\"worldTransform\":[1,0,0,0,0,1,0,0,0,0,1,0,0,0,0,1]}],\"region\":\"EMEA\"}")  # graph input

# group: Get the Proposal
# We want all buildings under the proposal only in the Forma tree hierarky. We start by finding the Proposal and then get all direct children of this element.
code_block = CodeBlock { "category"; }
valueAtKey = DesignScript.Builtin.Dictionary.ValueAtKey(key=code_block)  # unwired: dictionary
properties = Forma.Elements.Element.Properties(element=get_all_elements_from_site)
# note: Use function passing hack to ensrue we don't propagate warnings that are unavoidable with missing key-value pairs
function_apply = ApplyFunction(function=valueAtKey, argument0=properties)
code_block_2 = CodeBlock(prop=function_apply) { prop == "proposal"; }
filterByBoolMask = List.FilterByBoolMask(list=get_all_elements_from_site, mask=code_block_2)
children = Forma.Elements.Element.Children(element=filterByBoolMask.in)

flatten = List.Flatten(list=children)

# group: Get children of compositions (Row Houses)
# Buildings in row houses is grouped under a comosition element.
children_2 = Forma.Elements.Element.Children(element=filterByBoolMask.in)
code_block_3 = CodeBlock { "category"; }
valueAtKey_2 = DesignScript.Builtin.Dictionary.ValueAtKey(key=code_block_3)  # unwired: dictionary
properties_2 = Forma.Elements.Element.Properties(element=children_2)
# note: Use function passing hack to ensrue we don't propagate warnings that are unavoidable with missing key-value pairs
function_apply_2 = ApplyFunction(function=valueAtKey_2, argument0=properties_2)
code_block_4 = CodeBlock(prop=function_apply_2) { prop == "composition"; }
filterByBoolMask_2 = List.FilterByBoolMask(list=children_2, mask=code_block_4)
getAllChildren = Forma.Elements.Element.GetAllChildren(element=filterByBoolMask_2.in)
flatten_2 = List.Flatten(list=getAllChildren)

join = List.Join(list0=flatten, list1=flatten_2)

# group: Get buildings in the Proposal and not in the Base
# Filter the elements to extract the buildings
code_block_5 = CodeBlock(AllPropoaslElements=join) { AllPropoaslElements; }
code_block_6 = CodeBlock { "category"; }
valueAtKey_3 = DesignScript.Builtin.Dictionary.ValueAtKey(key=code_block_6)  # unwired: dictionary
properties_3 = Forma.Elements.Element.Properties(element=code_block_5)
# note: Use function passing hack to ensrue we don't propagate warnings that are unavoidable with missing key-value pairs
function_apply_3 = ApplyFunction(function=valueAtKey_3, argument0=properties_3)
code_block_7 = CodeBlock(prop=function_apply_3) { prop == "building"; }
filterByBoolMask_3 = List.FilterByBoolMask(list=code_block_5, mask=code_block_7)

# group: Find Buildings with GFAUnits in the element hierarchy
# Find all building elements that contains a GFA Unit representation. These can eiher be directly on the building element, or at any of the children elements for
# the building. In this first pass we use the HasRepresentation node to filter out these buildings. The ones who do not have the representation is
# passed on to visualize these in Red color.
flatten_3 = List.Flatten(list=filterByBoolMask_3.in)
getAllChildren_2 = Forma.Elements.Element.GetAllChildren(element=filterByBoolMask_3.in)
code_block_8 = CodeBlock { "gfaUnits"; }
hasRepresentation = Forma.Elements.Element.HasRepresentation(element=getAllChildren_2, key=code_block_8)
anyTrue = List.AnyTrue(list=hasRepresentation@L2)
filterByBoolMask_4 = List.FilterByBoolMask(list=flatten_3, mask=anyTrue)

# group: Filter For function and Unit Type
unit_type = CustomSelection("Unspecified", items={Living Unit: "LIVING_UNIT", Core: "CORE", Unspecified: "unspecified"}, IsVisibleDropDownTextBlock=true)  # graph input
function = CustomSelection("Unspecified", items={Residential: "residential", Commercial: "commercial", Unspecified: "unspecified"}, IsVisibleDropDownTextBlock=true)  # graph input

# group: Calculate Inclusion of Area
getAllChildren_3 = Forma.Elements.Element.GetAllChildren(element=filterByBoolMask_4.in)
flatten_4 = List.Flatten(list=getAllChildren_3)
GFAUnits = Forma.Elements.Element.GFAUnits(elements=flatten_4)
patch = Curve.Patch(curve=GFAUnits.curve)
code_block_9 = CodeBlock(target=unit_type, value=GFAUnits.areaType) { target == "unspecified" || target == value; }
code_block_10 = CodeBlock(target=function, value=GFAUnits.functionId) { target == "unspecified" || target == value; }
and_ = And(bool0=code_block_9, bool1=code_block_10)
filterByBoolMask_5 = List.FilterByBoolMask(list=patch, mask=and_)

# group: Visualize Calculated Areas
# Visualize the calculated areas with a slightly transparent blue color.
color_palette = ColorPalette({R: 44, G: 123, B: 182, A: 255})
byGeometryColor = Modifiers.GeometryColor.ByGeometryColor(geometry=filterByBoolMask_5.in, color=color_palette)
perimeterCurves = Surface.PerimeterCurves(surface=filterByBoolMask_5.in)
included = Watch3D(byGeometryColor, perimeterCurves)  # graph output

# group: Visualize excluded Areas by function and Unit Filters
# Visualize the areas excluded by the function and unit type filters.
color_palette_2 = ColorPalette({R: 253, G: 174, B: 97, A: 255})
byGeometryColor_2 = Modifiers.GeometryColor.ByGeometryColor(geometry=filterByBoolMask_5.out, color=color_palette_2)
perimeterCurves_2 = Surface.PerimeterCurves(surface=filterByBoolMask_5.out)
excluded = Watch3D(byGeometryColor_2, perimeterCurves_2)  # graph output

# group: Visualize Included Buildings
# Render the building volumes which are included in the calculation with a transparent blue color.
code_block_11 = CodeBlock { "volumeMesh"; }
hasRepresentation_2 = Forma.Elements.Element.HasRepresentation(element=getAllChildren_3, key=code_block_11)
filterByBoolMask_6 = List.FilterByBoolMask(list=getAllChildren_3, mask=hasRepresentation_2)
volumeMesh = Forma.Elements.Element.VolumeMesh(elements=filterByBoolMask_6.in)
buildings_on_site = Autodesk.Dynamo.MeshToolkit.Mesh.ByVerticesAndIndices(vertices=volumeMesh.vertices, indices=volumeMesh.indices)
color_palette_3 = ColorPalette({R: 121, G: 190, B: 212, A: 30})
byMeshColor = Autodesk.Dynamo.MeshToolkit.Display.MeshDisplay.ByMeshColor(mesh=buildings_on_site, meshColoring=color_palette_3)
building_included = Watch3D(byMeshColor)  # graph output

# group: All Buildings Without GFAUnits
# Visualize any building element that does not have GFA Units representations. There are not included in the Area calculations.
getAllChildren_4 = Forma.Elements.Element.GetAllChildren(element=filterByBoolMask_4.out)  # frozen
volumeMesh_2 = Forma.Elements.Element.VolumeMesh(elements=getAllChildren_4)
byVerticesAndIndices = Autodesk.Dynamo.MeshToolkit.Mesh.ByVerticesAndIndices(vertices=volumeMesh_2.vertices, indices=volumeMesh_2.indices)
# note: Explode Meshes to translate away from existing Forma building and remove z-fighting issues
explode = Autodesk.Dynamo.MeshToolkit.Mesh.Explode(mesh=byVerticesAndIndices)
flatten_5 = List.Flatten(list=explode)
# note: Get all Normals from all Mesh triangles as a Vector
triangleNormals = Autodesk.Dynamo.MeshToolkit.Mesh.TriangleNormals(mesh=flatten_5)
# note: Small scale factor for Mesh
code_block_12 = CodeBlock { 0.02; }
# note: Translate our exploded Mesh out by a small factor to remove z-fighting issues
translate = Autodesk.Dynamo.MeshToolkit.Mesh.Translate(mesh=flatten_5, vector=triangleNormals, distance=code_block_12)
color_palette_4 = ColorPalette({R: 215, G: 25, B: 28, A: 255})
byMeshColor_2 = Autodesk.Dynamo.MeshToolkit.Display.MeshDisplay.ByMeshColor(mesh=translate, meshColoring=color_palette_4)
buildings_without_gfaunits = Watch3D(byMeshColor_2)  # "Buildings Without GFAUnits (Excluded)"

# group: Compute Area Sum
# Calculate the sum of the areas calculated
area = Surface.Area(surface=filterByBoolMask_5.in)
area_2 = Math.Sum(values=area)
round = Math.Round(number=area_2)
string_from_object = FromObject(object=round)
code_block_13 = CodeBlock { "."; }
split = String.Split(string=string_from_object, separator0=code_block_13)
code_block_14 = CodeBlock(area=split) { area[0] + " m2"; }
calculated_area = Watch(code_block_14)  # graph output
