# Dynamo graph Butterfly Diagram.dyn (Dynamo 3.4.0.6892)
# author: The Dynamo Team
# Perform a shadow analysis on the site limit for the specified date, between 5am and 8pm. Darker shadows indicate that those areas are shaded for longer durations during the day.
# packages: MeshToolkit 5.1.0, DynamoFormaBeta 1.0.0.0

# group: Get Project and Select Site Limit
select_site_limit = SelectElementsHttp("{\"elements\":[{\"urn\":\"urn:adsk-forma-elements:basic:pro_mptwspj6cs:21c2739f14e8b+16fc42572b954:1743428996731\",\"path\":\"root/cd637ee\",\"worldTransform\":[1,0,0,0,0,1,0,0,0,0,1,0,0,0,0,1]}],\"region\":\"US\"}")  # graph input
collect_forma_site_id = GetSiteHttp("{\"projectId\":\"pro_mptwspj6cs\",\"siteId\":\"pro_mptwspj6cs\",\"region\":\"US\"}")  # graph input

# group: Size Display mesh to analysis bounding box
# note: Collect Site Footprint
footprint = Forma.Elements.Element.Footprint(elements=select_site_limit)
# note: Get Bounding Box of Geometry of site footprint
byGeometry = BoundingBox.ByGeometry(geom=footprint)
contextCoordinateSystem = BoundingBox.ContextCoordinateSystem(boundingBox=byGeometry)
origin = CoordinateSystem.Origin(coordinateSystem=contextCoordinateSystem)
maxPoint = BoundingBox.MaxPoint(boundingBox=byGeometry)
X = Point.X(point=maxPoint)
minPoint = BoundingBox.MinPoint(boundingBox=byGeometry)
X_2 = Point.X(point=minPoint)
code_block = CodeBlock(a=X, b=X_2) { a-b; }
Y = Point.Y(point=maxPoint)
Y_2 = Point.Y(point=minPoint)
code_block_2 = CodeBlock(a=Y, b=Y_2) { a-b; }

# group: Get Forma Proposal
# note: Collect all Forma Elements from the project
collect_forma_buildings = GetAllElementsHttp("{\"elements\":[{\"urn\":\"urn:adsk-forma-elements:proposal:pro_mptwspj6cs:75424654-bf42-4a51-8b67-0eeb15ae4fcc:1743428996733\",\"path\":\"root\",\"worldTransform\":[1,0,0,0,0,1,0,0,0,0,1,0,0,0,0,1]}],\"region\":\"US\"}")  # graph input
code_block_3 = CodeBlock { "proposal"; }
valueAtKey = DesignScript.Builtin.Dictionary.ValueAtKey()  # unwired: dictionary, key
code_block_4 = CodeBlock { "category"; }

# note: From collected Elements, get all their Properties
properties = Forma.Elements.Element.Properties(element=collect_forma_buildings)

# group (continued): Get Forma Proposal
# note: Using Funtion.Apply to suppress warnings on the Dictionary node due to the way the Forma data is structured which always results in a persistent Warning
function_apply = ApplyFunction(function=valueAtKey, argument0=properties, argument1=code_block_4)
eq = code_block_3 == function_apply
# note: We want only the Proposal so filter to get it
filterByBoolMask = List.FilterByBoolMask(list=collect_forma_buildings, mask=eq)
# note: Remove List structure
firstItem = List.FirstItem(list=filterByBoolMask.in)

# note: Collect the Unique Identifier for the Forma Proposal element to tell the Forma Sun Analysis which proposal to run on
URN = Forma.Elements.Element.URN(element=firstItem)
# note: Set the Path (Location) of your Site Limit inside the Forma project
path = Forma.Elements.Element.Path(element=select_site_limit)

# group: Set Date
set_analysis_date_mm_dd_yyyy = StringInput("09/21/2024")  # graph input

# group: Set Day of Analysis
fromString = DateTime.FromString(string=set_analysis_date_mm_dd_yyyy)
# note: Set Month and Day to run appropriate Sun Analysis on
components = DateTime.Components(dateTime=fromString)

# group: Set Timeout for Sun Analysis
sun_analysis_timeout_in_seconds = IntegerSlider(90, range=30..300 step 10)  # graph input

# note: Run the Forma Sun Analysis tool
runSunAnalysis = Forma.Analysis.Sun.RunSunAnalysis(site=collect_forma_site_id, rootUrn=URN, paths=path, month=components.month, date=components.day, maxTimeoutSeconds=sun_analysis_timeout_in_seconds)

# group: Single Day, Daytime hours
# note: Use DesignScript to set numerical ranges that define the Daytime hours across a single day
code_block_5 = CodeBlock()
# ---------- code_block_5.designscript (4 lines) ----------
//5am to 7pm at 3.5hour intervals
5..19..#5;
//6am to 8pm at 3.5hour intervals
6..20..#5;
# ----------------------------------------
# note: Collect Sun hours as a double for an hour range
sunHours = Forma.Analysis.Sun.SunHours(sun=runSunAnalysis, fromHour=code_block_5.out0, toHour=code_block_5.out1)

# group: Add up all the sample measures for each pixel of each hour
transpose = List.Transpose(lists=sunHours)
transpose_2 = List.Transpose(lists=transpose@L3)
# note: Sum results across each hour for each pixel
sum = Math.Sum(values=transpose_2)

# group: Align number of Analysis samples with display mesh
count = List.Count(list=sum@L2)
firstItem_2 = List.FirstItem(list=count)
count_2 = List.Count(list=sum@L3)
firstItem_3 = List.FirstItem(list=count_2)
code_block_6 = CodeBlock(x=firstItem_2, y=firstItem_3) { x-1; y-1; }

# group: Analysis Display mesh
# note: Generate Analysis Mesh plane from overall site boundary sizes, but homogenize to rectangular
plane = Autodesk.Dynamo.MeshToolkit.Mesh.Plane(origin=origin, xWidth=code_block, yWidth=code_block_2, xDivisions=code_block_6.out0, yDivisions=code_block_6.out1)
YAxis = Vector.YAxis()
byOriginNormal = Plane.ByOriginNormal(origin=origin, normal=YAxis)
# note: Mesh indices are reversed from the rest of Dynamo, so instead of doing list manipulations on the indice data, it's simpler to do a geometrical one
mirror = Autodesk.Dynamo.MeshToolkit.Mesh.Mirror(mesh=plane, mirrorPlane=byOriginNormal)

# group: Project Analysis display mesh onto terrain
# note: Collect Forma project terrain
collect_terrain_mesh = GetTerrainHttp("{\"elements\":[{\"urn\":\"urn:adsk-forma-elements:terrain:pro_mptwspj6cs:2446a771-fd25-47df-b95b-9b0ddd94b3ad:1731012856241\",\"path\":\"root/47150687-a650-4ee5-889d-00ce37cc1a12\",\"worldTransform\":[1,0,0,0,0,1,0,0,0,0,1,0,0,0,0,1]}],\"region\":\"US\"}")  # graph input
# note: Collect Volume Mesh from terrain that gives us vertices and indices
volumeMesh = Forma.Elements.Element.VolumeMesh(elements=collect_terrain_mesh)
# note: Create terrain representation in Dynamo as Mesh
byVerticesAndIndices = Autodesk.Dynamo.MeshToolkit.Mesh.ByVerticesAndIndices(vertices=volumeMesh.vertices, indices=volumeMesh.indices)
firstItem_4 = List.FirstItem(list=byVerticesAndIndices)
vertices = Autodesk.Dynamo.MeshToolkit.Mesh.Vertices(mesh=mirror)
ZAxis = Vector.ZAxis()
# note: Project vertices into correct Z-axis location for display in Forma project (i.e. Will not be underneath the Terrain)
project = Autodesk.Dynamo.MeshToolkit.Mesh.Project(mesh=firstItem_4, point=vertices, dir=ZAxis)
# note: Creat a Vector across the Z-axis only to use for Point Addition
code_block_7 = CodeBlock { Vector.ByCoordinates(0,0,0.1); }
# note: Add a very small buffer vertically in the Z-axis to ensure we don't have graphical systems fighting with each other and causing weird artifacts
add = Point.Add(point=project, vectorToAdd=code_block_7)
# note: Collect vertices from original Forma Mesh to project onto new Analysis Mesh
vertexIndicesByTri = Autodesk.Dynamo.MeshToolkit.Mesh.VertexIndicesByTri(mesh=mirror)
# note: Create a new Mesh to project analysis results onto for use within Forma project
byVerticesAndIndices_2 = Autodesk.Dynamo.MeshToolkit.Mesh.ByVerticesAndIndices(vertices=add, indices=vertexIndicesByTri)

# group: Normalize highest exposure to 1
flatten = List.Flatten(list=sum)
# note: Collect maximum value from summated list of Sun Hours
maximumItem = List.MaximumItem(list=flatten)
# note: Normalize highest values to 1 to set up for Color Gradient, as Value input must be between 0 and 1
code_block_8 = CodeBlock(a=sum, max=maximumItem) { a*(1/max); }

# group: Process exposure hour values to colors
color_palette = ColorPalette({R: 3, G: 3, B: 3, A: 0})
color_palette_2 = ColorPalette({R: 0, G: 32, B: 127, A: 255})
color_palette_3 = ColorPalette({R: 250, G: 250, B: 172, A: 255})
# note: Define color list for gradient. Note that we are using the same blue color twice to ensure a full, non-transitioning blue section.
list_create = List.Create(item0=color_palette, item1=color_palette_2, item2=color_palette_2, item3=color_palette_3)
# note: Define indices where colors sit on gradient
code_block_9 = CodeBlock()
# ---------- code_block_9.designscript (6 lines) ----------
[
	0, //Start with Grey
	0.001, //Very quickly shift to Blue
	0.2, //Maintain blue block without gradient
	1 //Transition to Pale Yellow with gradient
];
# ----------------------------------------
# note: Define a Color Range that runs from dark blue through to pale yellow
color_range = ColorRange(colors=list_create, indices=code_block_9, value=code_block_8)

# group: Display analysis
flatten_2 = List.Flatten(list=color_range)
# note: Use newly created Analysis Mesh and Index coloring to generate Butterfly Shadows
byMeshColor = Autodesk.Dynamo.MeshToolkit.Display.MeshDisplay.ByMeshColor(mesh=byVerticesAndIndices_2, meshColoring=flatten_2)
# note: Use Watch 3D node to send colored mesh back to Forma project
butterfly_shadow = Watch3D(byMeshColor)  # graph output
