# Dynamo graph Create Building Constraint.dyn (Dynamo 3.4.0.6892)
# author: The Dynamo Team
# Create Building Constraint using offsets from the selected site limit. Unique offsets can be specified for the front and other sides of the site limit. Note: May fail on complex site limits.
# packages: DynamoFormaBeta 1.0.0.0

# group: Select Site Limit
# note: Select Site Limit in Forma
select_site_limit = SelectElementsHttp("{\"elements\":[{\"urn\":\"urn:adsk-forma-elements:basic:pro_mptwspj6cs:75424654-bf42-4a51-8b67-0eeb15ae4fcc+93d316b1fb5f2:1741110318297\",\"path\":\"root/da21ddb\",\"worldTransform\":[1,0,0,0,0,1,0,0,0,0,1,0,0,0,0,1]}],\"region\":\"US\"}")  # graph input
# note: Get Site Limit's Footprint
footprint = Forma.Elements.Element.Footprint(elements=select_site_limit)
# note: Remove List Structure
firstItem = List.FirstItem(list=footprint)
firstItem_2 = List.FirstItem(list=firstItem)

# group: Set Total allowable height
height_meters = DoubleInput(50)  # graph input

curves = PolyCurve.Curves(polyCurve=firstItem_2)

# group: Identify primary street frontage of the building site > FrontageSelectionSet
curves_2 = PolyCurve.Curves(polyCurve=firstItem_2)
code_block = CodeBlock { 0.5; }
# note: Find the midpoint of each side of the site boundary
pointAtParameter = Curve.PointAtParameter(curve=curves_2, param=code_block)

# group: Identify primary street frontage of the building site
# note: Create surface from curve
byPatch = Surface.ByPatch(closedCurve=firstItem_2)
code_block_2 = CodeBlock { 0.5; }
# note: Find Midpoint
pointAtParameter_2 = Surface.PointAtParameter(surface=byPatch, u=code_block_2, v=code_block_2)
code_block_3 = CodeBlock { 100; }
# note: Create Circle
byCenterPointRadius = Circle.ByCenterPointRadius(centerPoint=pointAtParameter_2, radius=code_block_3)
# note: Create Plane
byOriginNormal = Plane.ByOriginNormal(origin=pointAtParameter_2)
code_block_4 = CodeBlock { 22.5; }
# note: Roate Circle 22.5 degrees to get the correct orientation
rotate = Geometry.Rotate(geometry=byCenterPointRadius, basePlane=byOriginNormal, degrees=code_block_4)
code_block_5 = CodeBlock { 8; }
# note: Create Polygon with 8 sides to represent the different directions
regularPolygon = Polygon.RegularPolygon(circle=rotate, numberSides=code_block_5)

# group: Set Frontage Orientation
orientation_of_frontage_n_ne_e = StringInput("N")  # "Orientation of Frontage (N, NE, E, SE, S, SW, W, NW)"; graph input

# group: Identify primary street frontage of the building site > Set Main Frontage
code_block_6 = CodeBlock { ["NE","N","NW","W","SW","S","SE","E"]; }
# note: Create curves from each side of the polygon
curves_3 = PolyCurve.Curves(polyCurve=regularPolygon)
# note: Match Curve to the Relevant Direction
byKeysValues = DesignScript.Builtin.Dictionary.ByKeysValues(keys=code_block_6, values=curves_3)
# note: Select the curve that matches the value the user has input
valueAtKey = DesignScript.Builtin.Dictionary.ValueAtKey(dictionary=byKeysValues, key=orientation_of_frontage_n_ne_e)

# group: Identify primary street frontage of the building site > Frontage Edge
# note: Find the closest side of the site boundary to the selected orientation
distanceTo = Geometry.DistanceTo(geometry=pointAtParameter, other=valueAtKey)
minimumItem = List.MinimumItem(list=distanceTo)
indexOf = List.IndexOf(list=distanceTo, element=minimumItem)

# group: Set Adjacency offset
offset_from_adjacent_property = DoubleInput(6)  # "Offset from Adjacent Property (meters)"; graph input

# group: Calculate Adjacency Footprint
# note: The non frontage sides of the site boundary are assumed to be adjacent to a neighbouring property and follow the same offset.
removeItemAtIndex = List.RemoveItemAtIndex(list=curves, indices=indexOf)
# note: Create polycuve from the sides
byJoinedCurves = PolyCurve.ByJoinedCurves(curves=removeItemAtIndex)
code_block_7 = CodeBlock(x=offset_from_adjacent_property) { -x; }

ZAxis = Vector.ZAxis()

# group: Calculate Adjacency Footprint > Offsets unpredictable. This gets the "inside one"
# note: Offset the relevant sides of the site boundary by the specified amount in both directions
offsetMany = Curve.OffsetMany(curve=byJoinedCurves, signedDistance=offset_from_adjacent_property, planeNormal=ZAxis)
length = Curve.Length(curve=offsetMany)
offsetMany_2 = Curve.OffsetMany(curve=byJoinedCurves, signedDistance=code_block_7, planeNormal=ZAxis)
length_2 = Curve.Length(curve=offsetMany_2)
lt = length < length_2
# note: Selecting the inner curve
if_ = RefactoredIf(test=lt, true=offsetMany, false=offsetMany_2)

# group (continued): Calculate Adjacency Footprint
reverse = Curve.Reverse(curve=if_)
# note: Create curves to join the 2 curves
byBlendBetweenCurves = Curve.ByBlendBetweenCurves(curve1=reverse, curve2=byJoinedCurves)
join = List.Join(list0=reverse, list1=byJoinedCurves, list2=byBlendBetweenCurves)
byJoinedCurves_2 = PolyCurve.ByJoinedCurves(curves=join)
# note: Create a polycurve to combine the curves
closeWithLine = PolyCurve.CloseWithLine(polyCurve=byJoinedCurves_2)

# group: Set Frontage offset
offset_from_frontage_meters = DoubleInput(3)  # graph input

# group: Calculate Frontage Footprint
code_block_8 = CodeBlock(x=curves, n=indexOf) { x[n]; }
code_block_9 = CodeBlock { 30; }
# note: Extends the size of the curve for the frontage to make sure it overlaps with the other sides when extruded in a later step.
extendStart = Curve.ExtendStart(curve=code_block_8, distance=code_block_9)
extendEnd = Curve.ExtendEnd(curve=extendStart, distance=code_block_9)
code_block_10 = CodeBlock(x=offset_from_frontage_meters) { -x; }

# group: Calculate Frontage Footprint > Offsets unpredictable. This gets the "inside one"
# note: Offset the frontage side of the site boundary by the specified amount in both directions
offsetMany_3 = Curve.OffsetMany(curve=extendEnd, signedDistance=offset_from_frontage_meters, planeNormal=ZAxis)
length_3 = Curve.Length(curve=offsetMany_3)
offsetMany_4 = Curve.OffsetMany(curve=extendEnd, signedDistance=code_block_10, planeNormal=ZAxis)
length_4 = Curve.Length(curve=offsetMany_4)
lt_2 = length_3 < length_4
# note: Selecting the inner curve
if_2 = RefactoredIf(test=lt_2, true=offsetMany_3, false=offsetMany_4)

# group (continued): Calculate Frontage Footprint
reverse_2 = Curve.Reverse(curve=if_2)
# note: Create curves to join the 2 curves
byBlendBetweenCurves_2 = Curve.ByBlendBetweenCurves(curve1=reverse_2, curve2=extendEnd)
join_2 = List.Join(list0=reverse_2, list1=extendEnd, list2=byBlendBetweenCurves_2)
byJoinedCurves_3 = PolyCurve.ByJoinedCurves(curves=join_2)
# note: Create a polycurve to combine the curves
closeWithLine_2 = PolyCurve.CloseWithLine(polyCurve=byJoinedCurves_3)

# group: Total Building Height Volume
# note: Extrude the Site Boundary to the specified height
extrudeAsSolid = Curve.ExtrudeAsSolid(curve=firstItem_2, distance=height_meters)
join_3 = List.Join(list0=closeWithLine, list1=closeWithLine_2)
# note: Extrude the offsets
extrudeAsSolid_2 = Curve.ExtrudeAsSolid(curve=join_3, distance=height_meters)
# note: Combine the offset geometry
byUnion = Solid.ByUnion(solids=extrudeAsSolid_2)
# note: Extract the extruded offset geometry from the extruded site boundary
difference = Solid.Difference(solid=extrudeAsSolid, other=byUnion)

collect_terrain_mesh = GetTerrainHttp("{\"elements\":[{\"urn\":\"urn:adsk-forma-elements:terrain:pro_mptwspj6cs:2446a771-fd25-47df-b95b-9b0ddd94b3ad:1731012856241\",\"path\":\"root/47150687-a650-4ee5-889d-00ce37cc1a12\",\"worldTransform\":[1,0,0,0,0,1,0,0,0,0,1,0,0,0,0,1]}],\"region\":\"US\"}")  # graph input

# group: Move Constraint up to highest-elevation on Terrain as per Site Limit
explode = Geometry.Explode(geometry=closeWithLine)
startPoint = Curve.StartPoint(curve=explode)
endPoint = Curve.EndPoint(curve=explode)
join_4 = List.Join(list0=startPoint, list1=endPoint)
pruneDuplicates = Point.PruneDuplicates(points=join_4)
X = Point.X(point=pruneDuplicates)
Y = Point.Y(point=pruneDuplicates)
elevationAt = Forma.Elements.System.Terrain.ElevationAt(terrain=collect_terrain_mesh, x=X, y=Y)
maximumItem = List.MaximumItem(list=elevationAt)
translate = Geometry.Translate(geometry=difference, zTranslation=maximumItem)

# group: Create Constraint
collect_site_id = GetSiteHttp("{\"projectId\":\"pro_mptwspj6cs\",\"siteId\":\"pro_mptwspj6cs\",\"region\":\"US\"}")  # graph input
code_block_11 = CodeBlock { ["category"]; ["constraints"]; }
byKeysValues_2 = DesignScript.Builtin.Dictionary.ByKeysValues(keys=code_block_11.out0, values=code_block_11.out1)
# note: Create constraint for the acitve project using the geometry created using the specificied inputs and preset propeties.
constraint = SendToFormaHttp(site=collect_site_id, geometry=translate, properties=byKeysValues_2)  # graph output
