# Dynamo graph Create Element.dyn (Dynamo 3.4.0.6892)
# author: The Dynamo Team
# This graph shows how you can use Dynamo to create elements in Forma. In this example you ceate a contraint cube in the middle of the scene, you can adjust the size and category in Dynamo Player for Forma without opening the graph. Note: make sure you are using active categories, other text e.g. "floor" and "terrain" creates un-deletable elements.
# packages: DynamoFormaBeta 1.0.0.0

# group: Inputs
# note: Selelct a Cube Size
cube_size_meters = DoubleSlider(70, range=50..150 step 5)  # graph input
collect_terrain_mesh = GetTerrainHttp("{\"elements\":[{\"urn\":\"urn:adsk-forma-elements:terrain:pro_mptwspj6cs:2446a771-fd25-47df-b95b-9b0ddd94b3ad:1731012856241\",\"path\":\"root/47150687-a650-4ee5-889d-00ce37cc1a12\",\"worldTransform\":[1,0,0,0,0,1,0,0,0,0,1,0,0,0,0,1]}],\"region\":\"US\"}")  # graph input
# note: or set your own
or_specify_a_category_if_blank = StringInput("")  # "Or specify a category (If blank, Dropdown used)"; graph input
# note: Choose a predfined Category
choose_a_category = CustomSelection("Constraints", items={Generic: "generic", Buildings: "buildings", Constraints: "constraints", Roads: "roads"}, IsVisibleDropDownTextBlock=true)  # graph input

# group: Generate Geometry
byCoordinates = Point.ByCoordinates()
# note: This node sets where the shape is drawn
byOriginNormal = Plane.ByOriginNormal(origin=byCoordinates)
byWidthLength = Rectangle.ByWidthLength(plane=byOriginNormal, width=cube_size_meters, length=cube_size_meters)
# note: The 2D Geometry is extructed to create the solid
extrudeAsSolid = Curve.ExtrudeAsSolid(curve=byWidthLength, distance=cube_size_meters)

# group: Put Cube at Terrain height
X = Point.X(point=byCoordinates)
Y = Point.Y(point=byCoordinates)
elevationAt = Forma.Elements.System.Terrain.ElevationAt(terrain=collect_terrain_mesh, x=X, y=Y)
translate = Geometry.Translate(geometry=extrudeAsSolid, zTranslation=elevationAt)

# group: Set Element Properties
code_block = CodeBlock { "category"; }
# note: Pre-define a green color for the Cube
code_block_2 = CodeBlock { "color"; "#4B8B67"; }
list_create = List.Create(item0=code_block, item1=code_block_2.out0)
code_block_3 = CodeBlock { ""; }
eq = or_specify_a_category_if_blank == code_block_3
# note: If a custom Category is supplied, use that, otherwise if it's left blank use one of the dropdown Category choices
if_ = RefactoredIf(test=eq, true=choose_a_category, false=or_specify_a_category_if_blank)
# note: Forma API requires lowercase categorization, so we ensure that is the case
toLower = String.ToLower(string=if_)
list_create_2 = List.Create(item0=toLower, item1=code_block_2.out1)
# note: Dictionary format is needed to input the element properties
byKeysValues = DesignScript.Builtin.Dictionary.ByKeysValues(keys=list_create, values=list_create_2)

# group: Push Geometry to Forma
collect_forma_site_id = GetSiteHttp("{\"projectId\":\"pro_mptwspj6cs\",\"siteId\":\"pro_mptwspj6cs\",\"region\":\"US\"}")  # graph input
cube = SendToFormaHttp(site=collect_forma_site_id, geometry=translate, properties=byKeysValues)  # graph output
