# Dynamo graph Terrain Slope Analysis.dyn (Dynamo 3.4.0.6892)
# author: The Dynamo Team
# Display terrain slope from 0 to 45 degrees and above. Blue indicates flatness and red indicates steepness across a gradient, with solid red being 45 degrees or more. Green element indicates selected Analysis center.
# packages: DynamoFormaBeta 1.0.0.0, MeshToolkit 5.1.0

# group: Inputs
collect_terrain_mesh = GetTerrainHttp("{\"elements\":[{\"urn\":\"urn:adsk-forma-elements:terrain:pro_ml3pafljn6:c8ac3adc-732f-4bee-b648-32021127971d:1726752997200\",\"path\":\"root/9ced168a-2243-4cb1-8661-8885a26b9348\",\"worldTransform\":[1,0,0,0,0,1,0,0,0,0,1,0,0,0,0,1]}],\"region\":\"US\"}")  # graph input
select_analysis_center = SelectElementsHttp("{\"elements\":[{\"urn\":\"urn:adsk-forma-elements:basic:pro_ml3pafljn6:04a505bccdf26+a533edfe-0a12-4d5c-bfc4-98d6f6c96313:1726753115228\",\"path\":\"root/ccd59281-bd38-4fb1-aa1e-c049e9a654cc/86f1dea\",\"worldTransform\":[1,0,0,0,0,1,0,0,0,0,1,0,0,0,0,1]}],\"region\":\"US\"}")  # graph input
analysis_size = DoubleInput(80)  # graph input

# group: Create Terrain Mesh
# note: Deconstruct Forma VolumeMesh into vertices and indices
volumeMesh = Forma.Elements.Element.VolumeMesh(elements=collect_terrain_mesh)
# note: Generate Dynamo Mesh to analyze
byVerticesAndIndices = Autodesk.Dynamo.MeshToolkit.Mesh.ByVerticesAndIndices(vertices=volumeMesh.vertices, indices=volumeMesh.indices)
firstItem = List.FirstItem(list=byVerticesAndIndices)

# group: Extract approximate center of analysis
# Use rather brute-force method to find center point of selected Forma element
firstItem_2 = List.FirstItem(list=select_analysis_center)
# note: Deconstruct Forma VolumeMesh into vertices and indices
volumeMesh_2 = Forma.Elements.Element.VolumeMesh(elements=firstItem_2)
# note: Generate a sphere from all Forma Element mesh vertices
byBestFit = Sphere.ByBestFit(points=volumeMesh_2.vertices)
# note: Get center point of sphere
centerPoint = Sphere.CenterPoint(sphere=byBestFit)

# group: Make a nice tidy circular slice of terrain
code_block = CodeBlock { 0.05; }
# note: Translate new Mesh up by minimal amount to stop z-fighting issues in Forma Client
translate = Autodesk.Dynamo.MeshToolkit.Mesh.Translate(mesh=firstItem, z=code_block)
code_block_2 = CodeBlock(n=analysis_size) { n/2; }
# note: Generate a Sphere from center point to cover Terrain Analysis to a chosen diameter
sphere = Autodesk.Dynamo.MeshToolkit.Mesh.Sphere(origin=centerPoint, radius=code_block_2)
# note: Intersect new Terrain with this mesh to pull circular mesh faces out as our Analysis Plane
booleanIntersection = Autodesk.Dynamo.MeshToolkit.Mesh.BooleanIntersection(mesh=translate, tool=sphere)

# group: Terrain Angle Analysis
# note: Collect the surface Normal from each triangular Mesh Face
triangleNormals = Autodesk.Dynamo.MeshToolkit.Mesh.TriangleNormals(mesh=booleanIntersection)
ZAxis = Vector.ZAxis()
# note: Calcualte vector angle from Mesh Face and ZAxis base Vector
angleWithVector = Vector.AngleWithVector(vector=triangleNormals, otherVector=ZAxis)

# group: Generate Color Range based on Terrain Angle Analysis
color_palette = ColorPalette({R: 44, G: 123, B: 182, A: 255})
color_palette_2 = ColorPalette({R: 171, G: 217, B: 233, A: 255})
color_palette_3 = ColorPalette({R: 255, G: 255, B: 191, A: 255})
color_palette_4 = ColorPalette({R: 253, G: 174, B: 97, A: 255})
color_palette_5 = ColorPalette({R: 215, G: 25, B: 28, A: 255})
# note: List of colors
list_create = List.Create(item0=color_palette, item1=color_palette_2, item2=color_palette_3, item3=color_palette_4, item4=color_palette_5)
# note: Generate range of Indices
code_block_3 = CodeBlock { 0..1..#5; [0,0.2,0.3,0.6,1]; }
code_block_4 = CodeBlock { 0; 45; 0; 1; }
# note: Remap all Vectors between 0 and 45 to 0 and 1, with any other value above 45 becoming 1
mapTo = Math.MapTo(rangeMin=code_block_4.out0, rangeMax=code_block_4.out1, inputValue=angleWithVector, targetRangeMin=code_block_4.out2, targetRangeMax=code_block_4.out3)
# note: Generate Color Range based on Terrain Angle, with Blue representing flat, ranging through Yellow, Orange and up to Red that indicates more than 45 degree slopes.
color_range = ColorRange(colors=list_create, indices=code_block_3.out0, value=mapTo)

# group: Colorize Mesh Display
# note: Colorize Mesh display based on Color Range
byMeshColor = Autodesk.Dynamo.MeshToolkit.Display.MeshDisplay.ByMeshColor(mesh=booleanIntersection, meshColoring=color_range)
terrain_slope = Watch3D(byMeshColor)  # graph output

# group: Analysis Center
byVerticesAndIndices_2 = Autodesk.Dynamo.MeshToolkit.Mesh.ByVerticesAndIndices(vertices=volumeMesh_2.vertices, indices=volumeMesh_2.indices)
boolean = BoolSelector(false)
clean = List.Clean(list=byVerticesAndIndices_2, preserveIndices=boolean)
# note: Explode Meshes to translate away from existing Forma building and remove z-fighting issues
explode = Autodesk.Dynamo.MeshToolkit.Mesh.Explode(mesh=clean)
flatten = List.Flatten(list=explode)
# note: Get all Normals from all Mesh triangles as a Vector
triangleNormals_2 = Autodesk.Dynamo.MeshToolkit.Mesh.TriangleNormals(mesh=flatten)
# note: Small scale factor for Mesh
code_block_5 = CodeBlock { 0.02; }
# note: Translate our exploded Mesh out by a small factor to remove z-fighting issues
translate_2 = Autodesk.Dynamo.MeshToolkit.Mesh.Translate(mesh=flatten, vector=triangleNormals_2, distance=code_block_5)
color_palette_6 = ColorPalette({R: 190, G: 254, B: 5, A: 255})
byMeshColor_2 = Autodesk.Dynamo.MeshToolkit.Display.MeshDisplay.ByMeshColor(mesh=translate_2, meshColoring=color_palette_6)
target_element = Watch3D(byMeshColor_2)  # graph output
