# Dynamo graph View Element Properties.dyn (Dynamo 3.2.2.5494)
# author: The Dynamo Team
# View the properties of a single element in Forma
# packages: DynamoFormaBeta 4.2.3

# group: Get Forma Element Properties
select_one_element = SelectElementsHttp("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")  # graph input
# note: Flatten list
firstItem = List.FirstItem(list=select_one_element)
# note: Extract element properties - note these are in dictionary format
properties = Forma.Elements.Element.Properties(element=firstItem)

# group: Re-format dictionary into key: value strings
# note: Extract Dictionary Keys
keys = DesignScript.Builtin.Dictionary.Keys(dictionary=properties)
number = DoubleInput(0)
string = StringInput("  ")
insert = String.Insert(string=keys, index=number, toInsert=string)
# note: Extract the value associated with the key
valueAtKey = DesignScript.Builtin.Dictionary.ValueAtKey(dictionary=properties, key=keys)
string_2 = StringInput(": ")
insert_2 = String.Insert(string=valueAtKey, index=number, toInsert=string_2)
# note: Combine the keys and value in a new list
list_create = List.Create(item0=insert, item1=insert_2)
# note: Transpose the list so the key is with the relevant value
transpose = List.Transpose(lists=list_create)
# note: Flatten the list to remove the nested lists which improves the formatting
flatten = List.Flatten(list=transpose)

# group: Send results to Forma
element_properties = Watch(flatten)  # graph output
