# Dynamo graph View To Object Analysis.dyn (Dynamo 3.4.0.6892)
# author: The Dynamo Team
# Analyze the View access to target elements in a scene from another element. Yellow dots indicate high visibility, blue indicate no visibility. Green element indicates target element. Note: This will run slower the more obstruction elements you select.
# packages: VASA 0.4.0, MeshToolkit 5.1.0, DynamoFormaBeta 4.2.3

# group: Inputs
select_building_to_view_from = SelectElementsHttp("{\"elements\":[{\"urn\":\"urn:adsk-forma-elements:basic:pro_mptwspj6cs:19fdcfb3f4065+631cbebc-97aa-4a05-aecf-2bab28ef13e4:1731012912105\",\"path\":\"root/3b00b454-6e70-4c83-9e5c-b5b5e071ba67/10be96b\",\"worldTransform\":[1,0,0,0,0,1,0,0,0,0,1,0,0,0,0,1]}],\"region\":\"US\"}")  # graph input
select_obstacles_to_impede_view = SelectElementsHttp("{\"elements\":[{\"urn\":\"urn:adsk-forma-elements:basic:pro_mptwspj6cs:19fdcfb3f4065+31c3cfcb-92d9-419b-a766-b6b0ff328654:1731012912105\",\"path\":\"root/3b00b454-6e70-4c83-9e5c-b5b5e071ba67/a97a88\",\"worldTransform\":[1,0,0,0,0,1,0,0,0,0,1,0,0,0,0,1]}],\"region\":\"US\"}")  # graph input
select_view_target = SelectElementsHttp("{\"elements\":[{\"urn\":\"urn:adsk-forma-elements:basic:pro_mptwspj6cs:19fdcfb3f4065+9c6ee83e-3fb4-4b1f-957c-5051ab00d0c6:1731012912105\",\"path\":\"root/3b00b454-6e70-4c83-9e5c-b5b5e071ba67/a42e746\",\"worldTransform\":[1,0,0,0,0,1,0,0,0,0,1,0,0,0,0,1]}],\"region\":\"US\"}")  # graph input
# note: Analysis Resolution
analysis_density = DoubleSlider(0.3, range=0.1..1 step 0.1)  # graph input

# group: Building to Analyze Views from
firstItem = List.FirstItem(list=select_building_to_view_from)
# note: Get Vertices from selected Analysis Building that demarcates center
volumeMesh = Forma.Elements.Element.VolumeMesh(elements=firstItem)
isNull = Object.IsNull(object=volumeMesh.vertices)
firstItem_2 = List.FirstItem(list=isNull)
getAllChildren = Forma.Elements.Element.GetAllChildren(element=firstItem)
volumeMesh_2 = Forma.Elements.Element.VolumeMesh(elements=getAllChildren)
if_ = RefactoredIf(test=firstItem_2, true=volumeMesh_2.vertices, false=volumeMesh.vertices)
boolean = BoolSelector(false)
clean = List.Clean(list=if_, preserveIndices=boolean)
if_2 = RefactoredIf(test=firstItem_2, true=volumeMesh_2.indices, false=volumeMesh.indices)
clean_2 = List.Clean(list=if_2, preserveIndices=boolean)
byVerticesAndIndices = Autodesk.Dynamo.MeshToolkit.Mesh.ByVerticesAndIndices(vertices=clean, indices=clean_2)
trianglesAsNineNumbers = Autodesk.Dynamo.MeshToolkit.Mesh.TrianglesAsNineNumbers(mesh=byVerticesAndIndices)
flatten = List.Flatten(list=trianglesAsNineNumbers)

# group: Target to View
firstItem_3 = List.FirstItem(list=select_view_target)
children = Forma.Elements.Element.Children(element=firstItem_3)
join = List.Join(list0=firstItem_3, list1=children)
flatten_2 = List.Flatten(list=join)
volumeMesh_3 = Forma.Elements.Element.VolumeMesh(elements=flatten_2)
byVerticesAndIndices_2 = Autodesk.Dynamo.MeshToolkit.Mesh.ByVerticesAndIndices(vertices=volumeMesh_3.vertices, indices=volumeMesh_3.indices)
boolean_2 = BoolSelector(false)
clean_3 = List.Clean(list=byVerticesAndIndices_2, preserveIndices=boolean_2)
trianglesAsNineNumbers_2 = Autodesk.Dynamo.MeshToolkit.Mesh.TrianglesAsNineNumbers(mesh=clean_3)

# group: Select Obstacles that will impede Views
URN = Forma.Elements.Element.URN(element=select_obstacles_to_impede_view)
firstItem_4 = List.FirstItem(list=firstItem_3)
URN_2 = Forma.Elements.Element.URN(element=firstItem_4)
eq = URN == URN_2
# note: Remove View Target from obstacles set
filterByBoolMask = List.FilterByBoolMask(list=select_obstacles_to_impede_view, mask=eq)
# note: Get Vertices from selected Analysis Building that demarcates center
volumeMesh_4 = Forma.Elements.Element.VolumeMesh(elements=filterByBoolMask.out)
isNull_2 = Object.IsNull(object=volumeMesh_4.vertices)
firstItem_5 = List.FirstItem(list=isNull_2)
getAllChildren_2 = Forma.Elements.Element.GetAllChildren(element=filterByBoolMask.out)
volumeMesh_5 = Forma.Elements.Element.VolumeMesh(elements=getAllChildren_2)
if_3 = RefactoredIf(test=firstItem_5, true=volumeMesh_5.vertices, false=volumeMesh_4.vertices)
boolean_3 = BoolSelector(false)
clean_4 = List.Clean(list=if_3, preserveIndices=boolean_3)
if_4 = RefactoredIf(test=firstItem_5, true=volumeMesh_5.indices, false=volumeMesh_4.indices)
clean_5 = List.Clean(list=if_4, preserveIndices=boolean_3)
byVerticesAndIndices_3 = Autodesk.Dynamo.MeshToolkit.Mesh.ByVerticesAndIndices(vertices=clean_4, indices=clean_5)
boolean_4 = BoolSelector(false)
clean_6 = List.Clean(list=byVerticesAndIndices_3, preserveIndices=boolean_4)
trianglesAsNineNumbers_3 = Autodesk.Dynamo.MeshToolkit.Mesh.TrianglesAsNineNumbers(mesh=clean_6)
flatten_3 = List.Flatten(list=trianglesAsNineNumbers_3)

# group: Voxel Model Parameters
coarse_voxel_width_code_block = CodeBlock { 0.5; }
voxel_rotation_number_slider = DoubleSlider(0, range=-90..90 step 5)
vertical_level_of_detail_integer = IntegerSlider(2, range=0..5 step 1)  # "Vertical Level of Detail - Integer Slider"
finest_level_of_detail_integer = IntegerSlider(1, range=0..5 step 1)  # "Finest Level of Detail - Integer Slider"

# group: Voxel Model Axes
# A set of axes is to created for all voxel models.
byCoarseVoxelWidthAndOrigin = VASA.Core.Axes.ByCoarseVoxelWidthAndOrigin(coarseVoxelWidth=coarse_voxel_width_code_block, voxelRotation=voxel_rotation_number_slider, verticalLOD=vertical_level_of_detail_integer)
code_block = CodeBlock(voxelLOD=finest_level_of_detail_integer) { voxelLOD; }

# group: Building and Context Voxels
list_create = List.Create(item0=flatten, item1=flatten_3)
byTrianglesAndAxes = VASA.Core.VoxelModel.ByTrianglesAndAxes(trianglesAsNineNumbers=list_create, axes=byCoarseVoxelWidthAndOrigin, finestLOD=code_block)
flatten_4 = List.Flatten(list=byTrianglesAndAxes)
union = VASA.Operations.SolidOperations.Union(voxelModels=flatten_4)

# group: Tesselate Building for more sample points
closeCracks = Autodesk.Dynamo.MeshToolkit.Mesh.CloseCracks(mesh=byVerticesAndIndices)
makeWatertight = Autodesk.Dynamo.MeshToolkit.Mesh.MakeWatertight(mesh=closeCracks)
code_block_2 = CodeBlock(resolution=analysis_density) { 1000 * resolution; }
reduce = Autodesk.Dynamo.MeshToolkit.Mesh.Reduce(mesh=makeWatertight, triangleCount=code_block_2)

# group: Sample points on building walls
triangleCentroids = Autodesk.Dynamo.MeshToolkit.Mesh.TriangleCentroids(mesh=reduce)
triangleNormals = Autodesk.Dynamo.MeshToolkit.Mesh.TriangleNormals(mesh=reduce)
Z = Vector.Z(vector=triangleNormals)
abs = Math.Abs(number=Z)
code_block_3 = CodeBlock { 0.5; }
lt = abs < code_block_3
filterByBoolMask_2 = List.FilterByBoolMask(list=triangleCentroids, mask=lt)
filterByBoolMask_3 = List.FilterByBoolMask(list=triangleNormals, mask=lt)
code_block_4 = CodeBlock(VoxelWidth=coarse_voxel_width_code_block) { VoxelWidth*1.5; }
scale = Vector.Scale(vector=filterByBoolMask_3.in, scale_factor=code_block_4)
add = Point.Add(point=filterByBoolMask_2.in, vectorToAdd=scale)
flatten_5 = List.Flatten(list=add)
flatten_6 = List.Flatten(list=filterByBoolMask_3.in)
X = Vector.X(vector=flatten_6)
Y = Vector.Y(vector=flatten_6)
byCoordinates = Vector.ByCoordinates(x=X, y=Y)

# group: Aggregate all elements to volume for analysis extents
join_2 = List.Join(list0=flatten_5, list1=volumeMesh_3.vertices)
flatten_7 = List.Flatten(list=join_2)
code_block_5 = CodeBlock { false; }
clean_7 = List.Clean(list=flatten_7, preserveIndices=code_block_5)
byGeometry = BoundingBox.ByGeometry(geom=clean_7)
toCuboid = BoundingBox.ToCuboid(boundingBox=byGeometry)
centroid = Solid.Centroid(solid=toCuboid)
byOriginNormal = Plane.ByOriginNormal(origin=centroid)
code_block_6 = CodeBlock { 1.1; }
scale_2 = Geometry.Scale(geometry=toCuboid, plane=byOriginNormal, xamount=code_block_6, yamount=code_block_6, zamount=code_block_6)

# group: Analysis Extents
# A set of extents large enough to contain the skydome plus padding is created to ensure the visibility computation has sufficient range.
byGeometryAndAxes = VASA.Core.VoxelModel.ByGeometryAndAxes(geometry=scale_2, axes=byCoarseVoxelWidthAndOrigin, finestLOD=code_block)
extents = VASA.Core.VoxelModel.Extents(voxelModel=byGeometryAndAxes)
finestLOD = VASA.Core.VoxelModel.FinestLOD(voxelModel=byGeometryAndAxes)

# group: Voxels for Visibility
# The voxel model representing the building and context is resized to contain the entire skydome.
resize = VASA.Core.VoxelModel.Resize(voxelModel=union, newExtents=extents)

# group: Display Building and Context Voxels
color_palette = ColorPalette({R: 226, G: 229, B: 8, A: 75})
displayVoxels = VASA.Core.VoxelModel.DisplayVoxels(voxelModel=resize, color=color_palette)

# group: Display Analysis Extents
displayExtents = VASA.Core.Extents.DisplayExtents(extents=extents)

# group: Views from Points on the building
# The view from a point on a window is computed.
code_block_7 = CodeBlock { 0.001; }
visibilityFromPoint = VASA.Operations.VisibilityOperations.VisibilityFromPoint(voxelModel=resize, point=flatten_5, voxelLOD=code_block_7)

# group: Target Voxels
# The skydome voxels are identifed by voxelizing the spheres and filling the region between them.
byTrianglesAndAxes_2 = VASA.Core.VoxelModel.ByTrianglesAndAxes(trianglesAsNineNumbers=trianglesAsNineNumbers_2, axes=byCoarseVoxelWidthAndOrigin, finestLOD=finestLOD)
union_2 = VASA.Operations.SolidOperations.Union(voxelModels=byTrianglesAndAxes_2)
firstItem_6 = List.FirstItem(list=union_2)

# group: Visible Target Voxels
# The visible part of the skydome is approximated by intersecting the voxels visible from a point with all voxels that are part of the skydome.
count = List.Count(list=visibilityFromPoint)
ofRepeatedItem = List.OfRepeatedItem(item=firstItem_6, amount=count)
list_create_2 = List.Create(item0=visibilityFromPoint, item1=ofRepeatedItem)
transpose = List.Transpose(lists=list_create_2)
intersect = VASA.Operations.SolidOperations.Intersect(voxelModels=transpose, voxelLOD=code_block_7)

# group: Percent of target that is visible
# The Vertical Sky Component metric is approximated by dividing the number of visible skydome voxels by the total number of skydome voxels.
countFilled = VASA.Core.VoxelModel.CountFilled(voxelModel=intersect)
countFilled_2 = VASA.Core.VoxelModel.CountFilled(voxelModel=firstItem_6)
div = countFilled / countFilled_2
remapRange = Math.RemapRange(numbers=div)

# group: Create Color Range
color_palette_2 = ColorPalette({R: 0, G: 39, B: 153, A: 255})
color_palette_3 = ColorPalette({R: 159, G: 159, B: 159, A: 255})
color_palette_4 = ColorPalette({R: 255, G: 255, B: 0, A: 255})
join_3 = List.Join(list0=color_palette_2, list1=color_palette_3, list2=color_palette_4)
code_block_8 = CodeBlock { 0..1..#3; }
color_range = ColorRange(colors=join_3, indices=code_block_8, value=remapRange)

# group: Display Visible Target Voxels
displayVoxels_2 = VASA.Core.VoxelModel.DisplayVoxels(voxelModel=intersect, color=color_range, voxelLOD=code_block_7)  # frozen
integer_slider = IntegerSlider(84, range=0..223 step 1)
code_block_9 = CodeBlock(x=displayVoxels_2, i=integer_slider) { x[i]; }

# group: Display Viewshaft Voxels
color_palette_5 = ColorPalette({R: 255, G: 192, B: 0, A: 255})
displayVoxels_3 = VASA.Core.VoxelModel.DisplayVoxels(voxelModel=visibilityFromPoint, color=color_palette_5)  # frozen
integer_slider_2 = IntegerSlider(101, range=0..150 step 1)
code_block_10 = CodeBlock(x=displayVoxels_3, i=integer_slider_2) { x[i]; }

# group: Display surfaces
code_block_11 = CodeBlock { 0.5; }
byCenterPointRadiusNormal = Circle.ByCenterPointRadiusNormal(centerPoint=flatten_5, radius=code_block_11, normal=byCoordinates)
byPatch = Surface.ByPatch(closedCurve=byCenterPointRadiusNormal)

# group: View to Object Success/Failure Results
byGeometryColor = Modifiers.GeometryColor.ByGeometryColor(geometry=byPatch, color=color_range)
visibility_to_target = Watch3D(byGeometryColor)  # graph output

# group: Target Object
# note: Explode Meshes to translate away from existing Forma building and remove z-fighting issues
explode = Autodesk.Dynamo.MeshToolkit.Mesh.Explode(mesh=clean_3)
flatten_8 = List.Flatten(list=explode)
# note: Get all Normals from all Mesh triangles as a Vector
triangleNormals_2 = Autodesk.Dynamo.MeshToolkit.Mesh.TriangleNormals(mesh=flatten_8)
# note: Small scale factor for Mesh
code_block_12 = CodeBlock { 0.02; }
# note: Translate our exploded Mesh out by a small factor to remove z-fighting issues
translate = Autodesk.Dynamo.MeshToolkit.Mesh.Translate(mesh=flatten_8, vector=triangleNormals_2, distance=code_block_12)
color_palette_6 = ColorPalette({R: 190, G: 254, B: 5, A: 255})
byMeshColor = Autodesk.Dynamo.MeshToolkit.Display.MeshDisplay.ByMeshColor(mesh=translate, meshColoring=color_palette_6)
target_element = Watch3D(byMeshColor)  # graph output
