# Dynamo graph Viewshed Analysis.dyn (Dynamo 3.4.0.6892)
# author: The Dynamo Team
# Displays a viewshed (isovist) for an element within a chosen circular radius at the ground plane. A viewshed represents the visible area from a particular point, showing what can be seen from the element within the defined radius. Note: If you have sloped terrain, some of the viewshed may be obscured underneath it.
# packages: MeshToolkit 5.1.0, DynamoFormaBeta 1.0.0.0, Refinery Toolkit 1.1.1

# group: Inputs
select_analysis_center = SelectElementsHttp("{\"elements\":[{\"urn\":\"urn:adsk-forma-elements:parametric:pro_mptwspj6cs:eed95e01e04d8:1743195454327-ed3e2f3\",\"path\":\"root/d6477ee\",\"worldTransform\":[1,0,0,0,0,1,0,0,0,0,1,0,1.0864646149554318,-7.549923993162281,-1.5884126845935667,1]}],\"region\":\"US\"}")  # graph input
firstItem = List.FirstItem(list=select_analysis_center)
set_analysis_size = DoubleInput(100)  # graph input
# note: Selecdt Buildings that will obstruct the Isovist
select_obstructions = SelectElementsHttp("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")  # graph input
collect_terrain_mesh = GetTerrainHttp("{\"elements\":[{\"urn\":\"urn:adsk-forma-elements:terrain:pro_mptwspj6cs:2446a771-fd25-47df-b95b-9b0ddd94b3ad:1731012856241\",\"path\":\"root/47150687-a650-4ee5-889d-00ce37cc1a12\",\"worldTransform\":[1,0,0,0,0,1,0,0,0,0,1,0,0,0,0,1]}],\"region\":\"US\"}")  # graph input

# group: extract approximate center of analysis
# note: Get Vertices from selected Analysis Building that demarcates center
volumeMesh = Forma.Elements.Element.VolumeMesh(elements=firstItem)
isNull = Object.IsNull(object=volumeMesh.vertices)
firstItem_2 = List.FirstItem(list=isNull)
getAllChildren = Forma.Elements.Element.GetAllChildren(element=firstItem)
volumeMesh_2 = Forma.Elements.Element.VolumeMesh(elements=getAllChildren)
if_ = RefactoredIf(test=firstItem_2, true=volumeMesh_2.vertices, false=volumeMesh.vertices)
boolean = BoolSelector(false)
clean = List.Clean(list=if_, preserveIndices=boolean)
# note: Generate a Sphere from these Vertices
byBestFit = Sphere.ByBestFit(points=clean)
# note: Find the Center Point of this Sphere to become our Analysis center for Viewshed Analysis
centerPoint = Sphere.CenterPoint(sphere=byBestFit)
Z = Point.Z(point=centerPoint)
code_block = CodeBlock(z=Z) { -z; }
# note: Ensure we translate downwards to the zero Z-value plane to run Viewshed Analysis on
translate = Geometry.Translate(geometry=centerPoint, zTranslation=code_block)

# group: Remove target element from obstructions
# note: Collect the Unique Identifier for the Forma Proposal element of the Building set to be Analysis Center
URN = Forma.Elements.Element.URN(element=firstItem)
# note: Collect all Unique Identifiers for the Forma Proposal elements that will form Obstructions
URN_2 = Forma.Elements.Element.URN(element=select_obstructions)
eq = URN == URN_2
# note: Remove the Analysis Center building from the list of obstructions if inadvertently selected
filterByBoolMask = List.FilterByBoolMask(list=select_obstructions, mask=eq)

# group: Filter to only generic, buildings, or building
# note: Query all Propeprties of Forma Elements
properties = Forma.Elements.Element.Properties(element=filterByBoolMask.out)
code_block_2 = CodeBlock { "category"; "building"; "buildings"; "generic"; }
# note: Pull out values from specific keys from the returned Dictionary of Element Properties
valueAtKey = DesignScript.Builtin.Dictionary.ValueAtKey(dictionary=properties, key=code_block_2.out0)
eq_2 = valueAtKey == code_block_2.out1
eq_3 = valueAtKey == code_block_2.out2
eq_4 = valueAtKey == code_block_2.out3
# note: If any of the Forma Elements are 'Building', 'Buildings' or 'Generic' then we pass it through, otherwise filter out.
or_ = Or(bool0=eq_2, bool1=eq_3, bool2=eq_4)
# note: Remove any non-building Forma elements from the Obstruction list
filterByBoolMask_2 = List.FilterByBoolMask(list=filterByBoolMask.out, mask=or_)

# group: Bounding Box to isolate pertinent elements
code_block_3 = CodeBlock { 500; }
# note: Generate a Cuboid out from the center of viewshed analysis, set to Analysis size
byLengths = Cuboid.ByLengths(origin=translate, width=set_analysis_size, length=set_analysis_size, height=code_block_3)
# note: Generate a Bounding Box from this Cuboid to run a containment test on
byGeometry = BoundingBox.ByGeometry(geom=byLengths)

# group: Only Analyze Buildings in the range of analysis center
# note: Get the vertices of each Forma Building
volumeMesh_3 = Forma.Elements.Element.VolumeMesh(elements=filterByBoolMask_2.in)
isNull_2 = Object.IsNull(object=volumeMesh_3.vertices)
firstItem_3 = List.FirstItem(list=isNull_2)
getAllChildren_2 = Forma.Elements.Element.GetAllChildren(element=filterByBoolMask_2.in)
volumeMesh_4 = Forma.Elements.Element.VolumeMesh(elements=getAllChildren_2)
if_2 = RefactoredIf(test=firstItem_3, true=volumeMesh_4.vertices, false=volumeMesh_3.vertices)
boolean_2 = BoolSelector(false)
clean_2 = List.Clean(list=if_2, preserveIndices=boolean_2)
# note: If the Obstruction vertex Points are within our Viewshed Analysis range, we use them, otherwise discard. This ensures better performance.
contains = BoundingBox.Contains(boundingBox=byGeometry, point=clean_2)
anyTrue = List.AnyTrue(list=contains@L2)
filterByBoolMask_3 = List.FilterByBoolMask(list=filterByBoolMask_2.in, mask=anyTrue)

# group: Make robust polygons out of heterogeneous building geometry
# note: Intersect these Meshes with the 0,0,0 Plane to get Building Footprints
intersect = Autodesk.Dynamo.MeshToolkit.Mesh.Intersect()  # unwired: mesh, intersectionPlane
volumeMesh_5 = Forma.Elements.Element.VolumeMesh(elements=filterByBoolMask_3.in)
boolean_3 = BoolSelector(false)
clean_3 = List.Clean(list=volumeMesh_5.vertices, preserveIndices=boolean_3)
clean_4 = List.Clean(list=volumeMesh_5.indices, preserveIndices=boolean_3)
# note: Create a Dynamo Mesh from the Forma VolumeMesh Vertices and Indices
byVerticesAndIndices = Autodesk.Dynamo.MeshToolkit.Mesh.ByVerticesAndIndices(vertices=clean_3, indices=clean_4)
# note: Generate Spheres arround each set of Vertices from each Building Mesh
byBestFit_2 = Sphere.ByBestFit(points=clean_3)
# note: Collect the Center Point of these Spheres
centerPoint_2 = Sphere.CenterPoint(sphere=byBestFit_2)
# note: Query the Z-Value of those Center Points
Z_2 = Point.Z(point=centerPoint_2)
# note: Make this value negative
code_block_4 = CodeBlock(z=Z_2) { -z; }
# note: Translate these Building Representations down to the base Plane in the Z-direction
translate_2 = Autodesk.Dynamo.MeshToolkit.Mesh.Translate(mesh=byVerticesAndIndices, z=code_block_4)
# note: Ensure our Meshes have no internal boundaries and are healthy mesh boxes
closeCracks = Autodesk.Dynamo.MeshToolkit.Mesh.CloseCracks(mesh=translate_2)
byOriginNormal = Plane.ByOriginNormal()
function_apply = ApplyFunction(function=intersect, argument0=closeCracks, argument1=byOriginNormal)
boolean_4 = BoolSelector(false)
clean_5 = List.Clean(list=function_apply, preserveIndices=boolean_4)
# note: Get the points of each Building Footprint
points = PolyCurve.Points(polyCurve=clean_5)
# note: Generate Polygons from these points
byPoints = Polygon.ByPoints(points=points)
code_block_5 = CodeBlock { false; }
# note: Clean up any failing Polygons
clean_6 = List.Clean(list=byPoints, preserveIndices=code_block_5)
# note: Flatten into a simple, easy to use List
flatten = List.Flatten(list=clean_6)

# group: Derive height of isovist display
X = Point.X(point=centerPoint)
Y = Point.Y(point=centerPoint)
# note: Query the Terrain height at the center point of Viewshed Analysis
elevationAt = Forma.Elements.System.Terrain.ElevationAt(terrain=collect_terrain_mesh, x=X, y=Y)
# note: Add a token value to ensure Viewshed Analysis isn't experiencing Z-fighting with the Terrain
code_block_6 = CodeBlock(h=elevationAt) { h+1; }

# group: Isovist
code_block_7 = CodeBlock(d=set_analysis_size) { d/2; }
# note: Define Analysis boundary, set by our Analysis Size input variable
byCenterPointRadius = Circle.ByCenterPointRadius(centerPoint=translate, radius=code_block_7)
code_block_8 = CodeBlock { 20; }
# note: Convert circle to Regular Polygon as input into Isovist analysis Node
regularPolygon = Polygon.RegularPolygon(circle=byCenterPointRadius, numberSides=code_block_8)
isovistFromPoint = Autodesk.RefineryToolkits.SpacePlanning.Analyze.Visibility.IsovistFromPoint(point=translate, boundary=regularPolygon, obstructions=flatten)
# note: Get a Surface from our Isovist Boundary
byPatch = Surface.ByPatch(closedCurve=regularPolygon)
# note: Ensure that the Isovist doesn't go beyond the Boundary
intersect_2 = Geometry.Intersect(geometry=isovistFromPoint, other=byPatch)
# note: Translate the Isovist back up to the correct height on the Z-Axis
translate_3 = Geometry.Translate(geometry=intersect_2, zTranslation=code_block_6)

# group: Analysis display
color_palette = ColorPalette({R: 218, G: 168, B: 6, A: 255})
# note: Colorize Viewshed Analysis outcome
byGeometryColor = Modifiers.GeometryColor.ByGeometryColor(geometry=translate_3, color=color_palette)
# note: Push Viewshed Analysis outcome (Colored surface) into Forma
analysis_surface = Watch3D(byGeometryColor)  # graph output
perimeterCurves = Surface.PerimeterCurves(surface=translate_3)
# note: Push Analysis Border (Curves) into Forma
analysis_border = Watch3D(perimeterCurves)  # graph output

# group: Percent of area visible
area = Surface.Area(surface=isovistFromPoint)
count = List.Count(list=area)
code_block_9 = CodeBlock { 1; }
gt = count > code_block_9
area_2 = Surface.Area(surface=byPatch)
count_2 = List.Count(list=area_2)
gt_2 = count_2 > code_block_9
or_2 = gt || gt_2
div = area / area_2
code_block_10 = CodeBlock { 100; }
mul = div * code_block_10
floor = Math.Floor(number=mul)
firstItem_4 = List.FirstItem(list=floor)
# note: Calculate percentage of area seen through Viewshed Analysis comparative to the full circular range
if_3 = RefactoredIf(test=or_2, true=firstItem_4, false=floor)
code_block_11 = CodeBlock(number=if_3) { number +"%"; }
# note: Push Percent of Area Visible back into Forma
visible_area = Watch(code_block_11)  # graph output
