# Dynamo graph ElementCreation.dyn "Create Element" (Dynamo 3.4.0.6892)
# author: The Dynamo Team
# This graph shows how you can use Dynamo to create elements in Forma. In this example you ceate a contraint cube in the middle of the scene, you can adjust the size and category in Dynamo Player for Forma without opening the graph. Note: make sure you are using active categories, other text e.g. "floor" and "terrain" creates un-deletable elements.
# packages: DynamoFormaBeta 1.0.0.0

# group: Set Cube Size
cube_size_meters = DoubleSlider(50, range=50..150 step 5)  # graph input

# group: Generate Geometry
# note: This node sets where the shape is drawn
byOriginNormal = Plane.ByOriginNormal()
byWidthLength = Rectangle.ByWidthLength(plane=byOriginNormal, width=cube_size_meters, length=cube_size_meters)
# note: The 2D Geometry is extructed to create the solid
extrudeAsSolid = Curve.ExtrudeAsSolid(curve=byWidthLength, distance=cube_size_meters)

# group: Set Category
specify_category_lower_case = StringInput("constraints")  # graph input

# group: Set Element Properties
code_block = CodeBlock { "category"; }
code_block_2 = CodeBlock { "color"; "#4B8B67"; }
list_create = List.Create(item0=code_block, item1=code_block_2.out0)
list_create_2 = List.Create(item0=specify_category_lower_case, item1=code_block_2.out1)
# note: Dictionary format is needed to input the element properties
byKeysValues = DesignScript.Builtin.Dictionary.ByKeysValues(keys=list_create, values=list_create_2)

# group: Push Geometry to Forma
collect_forma_site_id = GetSiteHttp("")  # graph input
cube = SendToFormaHttp(site=collect_forma_site_id, geometry=extrudeAsSolid, properties=byKeysValues)  # graph output
